# Grasshopper definition SimpleFrixelStructure.gh (Grasshopper 1.0.5)
# plug-ins: Kangaroo Components, Kangaroo2 Components

number_slider = Slider(98785828, range=0..100000000)
number_slider_2 = Slider(5.01, range=0..10)
vec = VectorXYZ(XComponent=Slider(1639, range=0..10000), YComponent=Slider(2672, range=0..10000), ZComponent=0)  # -> Vector, Length
c_script = CSharpScript(
    force=vec.Vector,
    Reference=["C:\Users\epoulsen\Documents\GitHub\frixel\Frixel.Optimizer\bin\Debug\Frixel.Core.dll", "C:\Users\epoulsen\Documents\GitHub\frixel\Frixel.Optimizer\bin\Debug\Frixel.Optimizer.dll", "C:\Users\epoulsen\Documents\GitHub\frixel\Frixel.Optimizer\bin\Debug\GeneticSharp.Domain.dll", "C:\Users\epoulsen\Documents\GitHub\frixel\Frixel.Optimizer\bin\Debug\GeneticSharp.Extensions.dll", "C:\Users\epoulsen\Documents\GitHub\frixel\Frixel.Optimizer\bin\Debug\GeneticSharp.Infrastructure.Framework.dll", "C:\Users\epoulsen\Documents\GitHub\frixel\Frixel.Optimizer\bin\Debug\GeneticSharp.Infrastructure.Threading.dll", "C:\Users\epoulsen\Documents\GitHub\frixel\Frixel.Optimizer\bin\Debug\MathNet.Numerics.dll", "C:\Users\epoulsen\Documents\GitHub\frixel\Frixel.Optimizer\bin\Debug\NCalc.dll", "C:\Users\epoulsen\Documents\GitHub\frixel\Frixel.Optimizer\bin\Debug\SharpFE.Core.dll", "C:\Users\epoulsen\Documents\GitHub\frixel\Frixel.Optimizer\bin\Debug\SmartThreadPool.dll"])  # -> out, A, B; inputs force: Vector3d
# ---------- c_script: C# ----------
    var pixStruct = Frixel.Core.ModelCreator.CreatePixelStructure();
    pixStruct.WindLoad.Direction = new Frixel.Core.Geometry.Point2d(force.X, force.Y);

    FrixelAnalyzer analyzer = new FrixelAnalyzer();
    AnalysisResults results = analyzer.Analyze(pixStruct);



    List<Point3d> pts = new List<Point3d>();
    List<Line> lines = new List<Line>();
    int i = 0;
    foreach (var node in pixStruct.Nodes)
    {
      double dispX = results.NodeResults[i].DispX;
      double dispY = results.NodeResults[i].DispY;

      pts.Add(new Point3d(node.X + dispX, 0, node.Y + dispY));
      i++;
    }

    foreach (Edge edge in pixStruct.Edges)
    {
      lines.Add(new Line(pts[edge.Start], pts[edge.End]));
    }

    foreach (Pixel pix in pixStruct.Pixels)
    {
      List<Edge> braces = pix.GetBracing();

      foreach (Edge brace in braces)
      {
        lines.Add(new Line(pts[brace.Start], pts[brace.End]));
      }
    }

    A = pts;
    B = lines;
# ---------- end c_script ----------
recgrid = Rectangular(Plane=PlaneXY(0, 0, 0), SizeX=1, SizeY=2, ExtentX=10, ExtentY=5)  # -> simplify(Cells), Points
panel = Panel(c_script.out)
pt = Point(flatten(recgrid.Points))
explode = Explode(Curve=recgrid.Cells, Recursive=True)  # -> Segments, Vertices
flatten = FlattenTree(Tree=explode.Segments, Path="{0}")
panel_2 = Panel("3,2,0,1")
duppt = RemoveDuplicatePts(Points=pt, Tolerance=0.01)
dupln = RemoveDuplicateLines(Lines=flatten, Tolerance=0.01)
branch = TreeBranch(Tree=recgrid.Cells, Path=Slider(5, range=0..10), MaintainPaths=True)
disc = Discontinuity(Curve=branch, Level=1)  # -> Points, Parameters
end = EndPoints(Curve=dupln)  # -> Start, End
item = ListItem(List=disc.Points, Index=Slider(0, range=0..10), Wrap=True)  # -> flatten(Item), flatten(Item1), flatten(Item2), flatten(Item3)
cp = ClosestPoint(Point=end.Start, Cloud=duppt)  # -> ClosestPoint, CPIndex, Distance
cp_2 = ClosestPoint(Point=end.End, Cloud=duppt)  # -> ClosestPoint, CPIndex, Distance
cp_3 = ClosestPoint(Point=item.Item3, Cloud=duppt)  # -> ClosestPoint, CPIndex, Distance
cp_4 = ClosestPoint(Point=item.Item2, Cloud=duppt)  # -> ClosestPoint, CPIndex, Distance
cp_5 = ClosestPoint(Point=item.Item, Cloud=duppt)  # -> ClosestPoint, CPIndex, Distance
cp_6 = ClosestPoint(Point=item.Item3, Cloud=duppt)  # -> ClosestPoint, CPIndex, Distance
c_script_2 = CSharpScript(
    nodes=duppt,
    edgeStart=cp.CPIndex,
    edgeEnd=cp_2.CPIndex,
    pix0=cp_3.CPIndex,
    pix1=cp_4.CPIndex,
    pix2=cp_5.CPIndex,
    pix3=cp_6.CPIndex,
    Reference=["C:\Users\epoulsen\Documents\GitHub\frixel\Frixel.Optimizer\bin\Debug\Frixel.Core.dll", "C:\Users\epoulsen\Documents\GitHub\frixel\Frixel.Optimizer\bin\Debug\Frixel.Optimizer.dll", "C:\Users\epoulsen\Documents\GitHub\frixel\Frixel.Optimizer\bin\Debug\GeneticSharp.Domain.dll", "C:\Users\epoulsen\Documents\GitHub\frixel\Frixel.Optimizer\bin\Debug\GeneticSharp.Extensions.dll", "C:\Users\epoulsen\Documents\GitHub\frixel\Frixel.Optimizer\bin\Debug\GeneticSharp.Infrastructure.Framework.dll", "C:\Users\epoulsen\Documents\GitHub\frixel\Frixel.Optimizer\bin\Debug\GeneticSharp.Infrastructure.Threading.dll", "C:\Users\epoulsen\Documents\GitHub\frixel\Frixel.Optimizer\bin\Debug\MathNet.Numerics.dll", "C:\Users\epoulsen\Documents\GitHub\frixel\Frixel.Optimizer\bin\Debug\NCalc.dll", "C:\Users\epoulsen\Documents\GitHub\frixel\Frixel.Optimizer\bin\Debug\SharpFE.Core.dll", "C:\Users\epoulsen\Documents\GitHub\frixel\Frixel.Optimizer\bin\Debug\SmartThreadPool.dll"])  # -> out, A, B; inputs nodes: list of Point3d, edgeStart: list of Int32, edgeEnd: list of Int32, pix0: list of Int32, pix1: list of Int32, pix2: list of Int32, pix3: list of Int32; disabled
# ---------- c_script_2: C# ----------
    PixelStructure structure = new PixelStructure();

    foreach (var node in nodes)
    {
      structure.Nodes.Add(new Frixel.Core.Geometry.Point2d(node.X, node.Y));

    }


    for (int i = 0; i < edgeStart.Count; i++)
    {
      int start = edgeStart[i];
      int end = edgeEnd[i];

      structure.Edges.Add(new Edge(start, end));

    }

    for (int i = 0; i < pix0.Count; i++)
    {
      int p0 = pix0[i];
      int p1 = pix1[i];
      int p2 = pix2[i];
      int p3 = pix3[i];

      structure.Pixels.Add(new Pixel(p0, p1, p2, p3, PixelState.Moment));

    }

    structure.WindLoad.Activated = true;
    structure.WindLoad.




    //var pixStruct = Frixel.Core.ModelCreator.CreatePixelStructure();
    //    pixStruct.WindLoad.Direction = new Frixel.Core.Geometry.Point2d(force.X, force.Y);
    //
    //    FrixelAnalyzer analyzer = new FrixelAnalyzer();
    //    AnalysisResults results = analyzer.Analyze(pixStruct);
    //
    //
    //
    //    List<Point3d> pts = new List<Point3d>();
    //    List<Line> lines = new List<Line>();
    //    int i = 0;
    //    foreach (var node in pixStruct.Nodes)
    //    {
    //      double dispX = results.NodeResults[i].DispX;
    //      double dispY = results.NodeResults[i].DispY;
    //
    //      pts.Add(new Point3d(node.X + dispX, 0, node.Y + dispY));
    //      i++;
    //    }
    //
    //    foreach (Edge edge in pixStruct.Edges)
    //    {
    //      lines.Add(new Line(pts[edge.Start], pts[edge.End]));
    //    }
    //
    //    foreach (Pixel pix in pixStruct.Pixels)
    //    {
    //      List<Edge> braces = pix.GetBracing();
    //
    //      foreach (Edge brace in braces)
    //      {
    //        lines.Add(new Line(pts[brace.Start], pts[brace.End]));
    //      }
    //    }
    //
    //    A = pts;
    //    B = lines;
# ---------- end c_script_2 ----------
